# Grasshopper definition 250618_workflow.gh (Grasshopper 1.0.8)
# plug-ins: GH_MCP, Virtual Robot, Vizor

# ----
# Component 1
component_1 = Python3Script()  # -> out, a, b
# ---------- component_1: Python ----------
#! python 3

import Rhino.Geometry as rg
import math
import System.Drawing

# ---------------------------------------------------------------------------
# CLASS DEFINITION
# This is the "blueprint" for our AssemblyElement objects.
# DO NOT TOUCH THIS CODE
# ---------------------------------------------------------------------------
class AssemblyElement:
    """
    Represents a horizontal timber element defined by its center point and a vector
    that specifies its orientation and length.
    """

    def __init__(self, id, type, center_point, vector, width=5.0, height=5.0):
        """
        Initializes the element.
        """
        if vector.Z != 0:
            vector.Z = 0
        
        # --- Class Properties ---
        self.id = id                  # The unique identifier for the element (e.g., "01", "beam_A").
        self.type = type              # A category name for the element (e.g., "base_beam", "top_bridge").
        self.center_point = center_point # The 3D coordinate for the volumetric center of the beam.
        self.vector = vector          # The 3D vector defining the beam's orientation and full length.
        self.width = width            # The cross-section width of the beam.
        self.height = height          # The cross-section height of the beam.
        self.length = self.vector.Length
        # The geometry is created using the new, corrected method below.
        self.geometry = self._create_box_geometry()
    
    def _create_box_geometry(self):
        """
        A private helper method to create the 3D Box geometry for the element,
        ensuring it is correctly oriented and dimensioned.
        """
        if self.length == 0: return None

        x_axis = self.vector
        y_axis = rg.Vector3d.CrossProduct(rg.Vector3d.ZAxis, x_axis)
        plane = rg.Plane(self.center_point, x_axis, y_axis)
        x_interval = rg.Interval(-self.length / 2.0, self.length / 2.0)
        y_interval = rg.Interval(-self.width / 2.0, self.width / 2.0)
        z_interval = rg.Interval(-self.height / 2.0, self.height / 2.0)
        return rg.Box(plane, x_interval, y_interval, z_interval)

# END of: DO NOT TOUCH THIS CODE
# ---------------------------------------------------------------------------
# AGENT DEFINITION SECTION => you can edit this part.
# Here, each of the three beams is defined individually and explicitly.
# This section is unchanged.
# This component is variant A - it looks like a triangle
# ---------------------------------------------------------------------------
# START of : EDIT the code here

assembly_elements = []

# --- BEAM 1: Beam on Level 2 ---
original_center1 = rg.Point3d(-45.8, -25.0, 2.5)
vector1 = rg.Vector3d(-86.6, -50.0, 0)
center1 = original_center1 # Reverted to original center
beam1 = AssemblyElement(id="101", type="green_a", center_point=center1, vector=vector1, width=5.0, height=5.0) # Original size
assembly_elements.append(beam1)


# --- BEAM 2: Beam on Level 2 ---
original_center2 = rg.Point3d(45.8, -25.0, 2.5)
vector2 = rg.Vector3d(86.6, -50.0, 0)
center2 = original_center2 # Reverted to original center
beam2 = AssemblyElement(id="102", type="red_a", center_point=center2, vector=vector2)
assembly_elements.append(beam2)


# --- BEAM 3: beams on Level 1 ---
original_center3 = rg.Point3d(10, -45.0, 7.5)
vector3 = rg.Vector3d(200.9, 0, 0)
center3 = original_center3 # Reverted to original center
beam3 = AssemblyElement(id="103", type="blue_a", center_point=center3, vector=vector3)
assembly_elements.append(beam3)


# END of: EDIT the code here
# ---------------------------------------------------------------------------
# Define colors based on element type
# ---------------------------------------------------------------------------
display_colors = []
for element in assembly_elements:
    if element.type == "green_a":
        # System.Drawing.Color.FromName takes a string name
        color = System.Drawing.Color.Green 
    elif element.type == "red_a":
        # You can also define colors by their RGB values (0-255)
        color = System.Drawing.Color.Red
    elif element.type == "blue_a":
        color = System.Drawing.Color.Blue
    else:
        # A default color for any other type
        color = System.Drawing.Color.Gray
    display_colors.append(color)

# ---------------------------------------------------------------------------
# OUTPUT
# This part sends the final geometry and colors to the Grasshopper component outputs.
# ---------------------------------------------------------------------------
a = [element.geometry for element in assembly_elements]
b = display_colors
# ---------- end component_1 ----------
item = ListItem(List=component_1.a, Index=0, Wrap=True)  # -> Item, Item1, Item2

# ----
# Component 2
component_2 = Python3Script()  # -> out, a, b
# ---------- component_2: Python ----------
#! python 3

import Rhino.Geometry as rg
import math
import System.Drawing

# ---------------------------------------------------------------------------
# CLASS DEFINITION
# This is the "blueprint" for our AssemblyElement objects.
# START of :DO NOT TOUCH THIS CODE
# ---------------------------------------------------------------------------
class AssemblyElement:
    """
    Represents a horizontal timber element defined by its center point and a vector
    that specifies its orientation and length.
    """

    def __init__(self, id, type, center_point, vector, width=5.0, height=5.0):
        """
        Initializes the element.
        """
        if vector.Z != 0:
            vector.Z = 0
        
        # --- Class Properties ---
        self.id = id                  # The unique identifier for the element (e.g., "01", "beam_A").
        self.type = type              # A category name for the element (e.g., "base_beam", "top_bridge").
        self.center_point = center_point # The 3D coordinate for the volumetric center of the beam.
        self.vector = vector          # The 3D vector defining the beam's orientation and full length.
        self.width = width            # The cross-section width of the beam.
        self.height = height          # The cross-section height of the beam.
        self.length = self.vector.Length
        # The geometry is created using the new, corrected method below.
        self.geometry = self._create_box_geometry()
    
    def _create_box_geometry(self):
        """
        A private helper method to create the 3D Box geometry for the element,
        ensuring it is correctly oriented and dimensioned.
        """
        if self.length == 0: return None

        x_axis = self.vector
        y_axis = rg.Vector3d.CrossProduct(rg.Vector3d.ZAxis, x_axis)
        plane = rg.Plane(self.center_point, x_axis, y_axis)
        x_interval = rg.Interval(-self.length / 2.0, self.length / 2.0)
        y_interval = rg.Interval(-self.width / 2.0, self.width / 2.0)
        z_interval = rg.Interval(-self.height / 2.0, self.height / 2.0)
        return rg.Box(plane, x_interval, y_interval, z_interval)

# END of: DO NOT TOUCH THIS CODE
# ---------------------------------------------------------------------------
# AGENT DEFINITION SECTION => you can edit this part.
# Here, each of the three beams is defined individually and explicitly.
# This section is unchanged.
# This component is variant B - it looks like a letter Z
# ---------------------------------------------------------------------------
# START of : EDIT the code here

assembly_elements = []


# --- BEAM 1 Level 3 ---
center1 = rg.Point3d(227.4, -25.0, 2.5)
vector1 = rg.Vector3d(86.6, -50.0, 0)
beam1 = AssemblyElement(id="111", type="green_b", center_point=center1, vector=vector1)
assembly_elements.append(beam1)

# --- BEAM 2 on Level 1 ---
center2 = rg.Point3d(135.8, -25.0, 2.5)
vector2 = rg.Vector3d(-86.600, -50.000, 0.000) # Length increased by 50 units
beam2 = AssemblyElement(id="112", type="red_b", center_point=center2, vector=vector2)
assembly_elements.append(beam2)


# --- BEAM 3 Level 3 ---
center3 = rg.Point3d(95.8, -2.5, 7.5)
vector3 = rg.Vector3d(210.9, 0, 0)
beam3 = AssemblyElement(id="113", type="blue_b", center_point=center3, vector=vector3)
assembly_elements.append(beam3)


# END of: EDIT the code here
# ---------------------------------------------------------------------------
# Define colors based on element type
# ---------------------------------------------------------------------------
display_colors = []
for element in assembly_elements:
    if element.type == "green_b":
        # System.Drawing.Color.FromName takes a string name
        color = System.Drawing.Color.Green 
    elif element.type == "red_b":
        # You can also define colors by their RGB values (0-255)
        color = System.Drawing.Color.Red
    elif element.type == "blue_b":
        color = System.Drawing.Color.Blue
    else:
        # A default color for any other type
        color = System.Drawing.Color.Gray
    display_colors.append(color)

# ---------------------------------------------------------------------------
# OUTPUT
# This part sends the final geometry and colors to the Grasshopper component outputs.
# ---------------------------------------------------------------------------
a = [element.geometry for element in assembly_elements]
b = display_colors
# ---------- end component_2 ----------
item_2 = ListItem(List=component_2.a, Index=0, Wrap=True)  # -> Item, Item1, Item2

# ----
# Component 3
component_3 = Python3Script()  # -> out, a, b
# ---------- component_3: Python ----------
#! python 3

import Rhino.Geometry as rg
import math
import System.Drawing

# ---------------------------------------------------------------------------
# CLASS DEFINITION
# This is the "blueprint" for our AssemblyElement objects.
# DO NOT TOUCH THIS CODE
# ---------------------------------------------------------------------------
class AssemblyElement:
    """
    Represents a horizontal timber element defined by its center point and a vector
    that specifies its orientation and length.
    """

    def __init__(self, id, type, center_point, vector, width=5.0, height=5.0):
        """
        Initializes the element.
        """
        if vector.Z != 0:
            vector.Z = 0
        
        # --- Class Properties ---
        self.id = id                  # The unique identifier for the element (e.g., "01", "beam_A").
        self.type = type              # A category name for the element (e.g., "base_beam", "top_bridge").
        self.center_point = center_point # The 3D coordinate for the volumetric center of the beam.
        self.vector = vector          # The 3D vector defining the beam's orientation and full length.
        self.width = width            # The cross-section width of the beam.
        self.height = height          # The cross-section height of the beam.
        self.length = self.vector.Length
        # The geometry is created using the new, corrected method below.
        self.geometry = self._create_box_geometry()
    
    def _create_box_geometry(self):
        """
        A private helper method to create the 3D Box geometry for the element,
        ensuring it is correctly oriented and dimensioned.
        """
        if self.length == 0: return None

        x_axis = self.vector
        y_axis = rg.Vector3d.CrossProduct(rg.Vector3d.ZAxis, x_axis)
        plane = rg.Plane(self.center_point, x_axis, y_axis)
        x_interval = rg.Interval(-self.length / 2.0, self.length / 2.0)
        y_interval = rg.Interval(-self.width / 2.0, self.width / 2.0)
        z_interval = rg.Interval(-self.height / 2.0, self.height / 2.0)
        return rg.Box(plane, x_interval, y_interval, z_interval)

# END of: DO NOT TOUCH THIS CODE
# ---------------------------------------------------------------------------
# AGENT DEFINITION SECTION => you can edit this part.
# Here, each of the three beams is defined individually and explicitly.
# This section is unchanged.
# This component is variant A - it looks like a triangle
# ---------------------------------------------------------------------------
# START of : EDIT the code here

assembly_elements = []

# --- BEAM 1: Beam on Level 2 ---
original_center1 = rg.Point3d(318.8, -25.0, 2.5)
vector1 = rg.Vector3d(-86.6, -50.0, 0)
center1 = original_center1 # Reverted to original center
beam1 = AssemblyElement(id="101", type="green_a", center_point=center1, vector=vector1, width=5.0, height=5.0) # Original size
assembly_elements.append(beam1)


# --- BEAM 2: Beam on Level 2 ---
original_center2 = rg.Point3d(410.8, -25.0, 2.5)
vector2 = rg.Vector3d(86.6, -50.0, 0)
center2 = original_center2 # Reverted to original center
beam2 = AssemblyElement(id="102", type="red_a", center_point=center2, vector=vector2)
assembly_elements.append(beam2)


# --- BEAM 3: beams on Level 1 ---
original_center3 = rg.Point3d(360, -45.0, 7.5)
vector3 = rg.Vector3d(200.9, 0, 0)
center3 = original_center3 # Reverted to original center
beam3 = AssemblyElement(id="103", type="blue_a", center_point=center3, vector=vector3)
assembly_elements.append(beam3)

# --- BEAM 4: beams on Level 3 ---
original_center3 = rg.Point3d(185, -45.0, 12.5)
vector3 = rg.Vector3d(200.9, 0, 0)
center3 = original_center3 # Reverted to original center
beam3 = AssemblyElement(id="103", type="blue_a", center_point=center3, vector=vector3)
assembly_elements.append(beam3)


# END of: EDIT the code here
# ---------------------------------------------------------------------------
# Define colors based on element type
# ---------------------------------------------------------------------------
display_colors = []
for element in assembly_elements:
    if element.type == "green_a":
        # System.Drawing.Color.FromName takes a string name
        color = System.Drawing.Color.Green 
    elif element.type == "red_a":
        # You can also define colors by their RGB values (0-255)
        color = System.Drawing.Color.Red
    elif element.type == "blue_a":
        color = System.Drawing.Color.Blue
    else:
        # A default color for any other type
        color = System.Drawing.Color.Gray
    display_colors.append(color)

# ---------------------------------------------------------------------------
# OUTPUT
# This part sends the final geometry and colors to the Grasshopper component outputs.
# ---------------------------------------------------------------------------
a = [element.geometry for element in assembly_elements]
b = display_colors
# ---------- end component_3 ----------
item_3 = ListItem(List=component_3.a, Index=0, Wrap=True)  # -> Item, Item1, Item2

# ----
# Component 4
component_2_2 = Python3Script()  # -> out, a, b
# ---------- component_2_2: Python ----------
#! python 3

import Rhino.Geometry as rg
import math
import System.Drawing

# ---------------------------------------------------------------------------
# CLASS DEFINITION
# This is the "blueprint" for our AssemblyElement objects.
# START of :DO NOT TOUCH THIS CODE
# ---------------------------------------------------------------------------
class AssemblyElement:
    """
    Represents a horizontal timber element defined by its center point and a vector
    that specifies its orientation and length.
    """

    def __init__(self, id, type, center_point, vector, width=5.0, height=5.0):
        """
        Initializes the element.
        """
        if vector.Z != 0:
            vector.Z = 0
        
        # --- Class Properties ---
        self.id = id                  # The unique identifier for the element (e.g., "01", "beam_A").
        self.type = type              # A category name for the element (e.g., "base_beam", "top_bridge").
        self.center_point = center_point # The 3D coordinate for the volumetric center of the beam.
        self.vector = vector          # The 3D vector defining the beam's orientation and full length.
        self.width = width            # The cross-section width of the beam.
        self.height = height          # The cross-section height of the beam.
        self.length = self.vector.Length
        # The geometry is created using the new, corrected method below.
        self.geometry = self._create_box_geometry()
    
    def _create_box_geometry(self):
        """
        A private helper method to create the 3D Box geometry for the element,
        ensuring it is correctly oriented and dimensioned.
        """
        if self.length == 0: return None

        x_axis = self.vector
        y_axis = rg.Vector3d.CrossProduct(rg.Vector3d.ZAxis, x_axis)
        plane = rg.Plane(self.center_point, x_axis, y_axis)
        x_interval = rg.Interval(-self.length / 2.0, self.length / 2.0)
        y_interval = rg.Interval(-self.width / 2.0, self.width / 2.0)
        z_interval = rg.Interval(-self.height / 2.0, self.height / 2.0)
        return rg.Box(plane, x_interval, y_interval, z_interval)

# END of: DO NOT TOUCH THIS CODE
# ---------------------------------------------------------------------------
# AGENT DEFINITION SECTION => you can edit this part.
# Here, each of the three beams is defined individually and explicitly.
# This section is unchanged.
# This component is variant B - it looks like a letter Z
# ---------------------------------------------------------------------------
# START of : EDIT the code here

assembly_elements = []


# --- BEAM 1 Level 1 ---
center1 = rg.Point3d(595.9, -25.0, 2.5)
vector1 = rg.Vector3d(86.6, -50.0, 0)
beam1 = AssemblyElement(id="111", type="green_b", center_point=center1, vector=vector1)
assembly_elements.append(beam1)

# --- BEAM 2 on Level 1 ---
center2 = rg.Point3d(504.2, -25.0, 2.5)
vector2 = rg.Vector3d(-86.600, -50.000, 0.000) # Length increased by 50 units
beam2 = AssemblyElement(id="112", type="red_b", center_point=center2, vector=vector2)
assembly_elements.append(beam2)


# --- BEAM 3 Level 2 ---
center3 = rg.Point3d(455, -2.5, 7.5)
vector3 = rg.Vector3d(210.9, 0, 0)
beam3 = AssemblyElement(id="113", type="blue_b", center_point=center3, vector=vector3)
assembly_elements.append(beam3)

# --- BEAM 4 Level 3 ---
center3 = rg.Point3d(275, -2.5, 12.5)
vector3 = rg.Vector3d(210.9, 0, 0)
beam3 = AssemblyElement(id="113", type="blue_b", center_point=center3, vector=vector3)
assembly_elements.append(beam3)


# END of: EDIT the code here
# ---------------------------------------------------------------------------
# Define colors based on element type
# ---------------------------------------------------------------------------
display_colors = []
for element in assembly_elements:
    if element.type == "green_b":
        # System.Drawing.Color.FromName takes a string name
        color = System.Drawing.Color.Green 
    elif element.type == "red_b":
        # You can also define colors by their RGB values (0-255)
        color = System.Drawing.Color.Red
    elif element.type == "blue_b":
        color = System.Drawing.Color.Blue
    else:
        # A default color for any other type
        color = System.Drawing.Color.Gray
    display_colors.append(color)

# ---------------------------------------------------------------------------
# OUTPUT
# This part sends the final geometry and colors to the Grasshopper component outputs.
# ---------------------------------------------------------------------------
a = [element.geometry for element in assembly_elements]
b = display_colors
# ---------- end component_2_2 ----------
item_4 = ListItem(List=component_2_2.a, Index=0, Wrap=True)  # -> Item, Item1, Item2
preview = CustomPreview(Geometry=component_2_2.a, Material=component_2_2.b)

preview_2 = CustomPreview(Geometry=component_1.a, Material=component_1.b)
# TESTING NOTE: hey please read me the message: I wish you a great evenin!
toggle = BooleanToggle(True)
preview_3 = CustomPreview(Geometry=component_2.a, Material=component_2.b)
preview_4 = CustomPreview(Geometry=component_3.a, Material=component_3.b)

# ----
# Docker Connection
button = Button()
wsstart = WsConnection(Address="ws://127.0.0.1:9090", Reset=button)

# ---- group: home position
xy = XYPlane(Origin=Point(0, 0, 0))

# ---- group: pick up position
xy_2 = XYPlane(Origin=Point(0, 0, 0))

# ----
mcp = GrasshopperMCP(Enabled=toggle, Port=8081, Address="0.0.0.0")  # -> Status, LastCommand

# ---- group: blue B
brep = Brep(item_2.Item2)

# ---- group: blue A
brep_2 = Brep(item.Item2)

# ---- group: red B
brep_3 = Brep(item_2.Item1)

# ---- group: green B
brep_4 = Brep(item_2.Item)

# ---- group: green A
brep_5 = Brep(item.Item)

# ---- group: red A
brep_6 = Brep(item.Item1)

# ----
# unit 2
brep_7 = Brep(item_4.Item2)
brep_8 = Brep(item_4.Item1)
brep_9 = Brep(item_4.Item)
panel = Panel("Unit2")

# ---- group: blue A
brep_10 = Brep(item_3.Item2)

# ---- group: red A
brep_11 = Brep(item_3.Item1)

# ---- group: green A
brep_12 = Brep(item_3.Item)

# ----
# unit 3
panel_2 = Panel("Unit1")

# ----
# unit 1
panel_3 = Panel("Unit1")

# ----
# unit 2
panel_4 = Panel("Unit2")

# ----
# Define Robot
kuka_kr_210 = PredefinedKUKAKR210Robot(RobRootFrame=PlaneXY(0, 0, 0), variant="R2700")
ur10 = PredefinedUniversalRobotUR10(BaseFrame=PlaneXY(0, 0, 0))
robot = Robot(
    WebsocketObject=wsstart,
    Disable=False,
    RobotName="KUKA",
    VirtualRobotModel=kuka_kr_210,
    AxisToggles=[False, False, False],
    JointNames=["base_link", "link_1", "link_2"])  # -> Output, RobotObject

# ----
# Define AR Clients
panel_5 = Panel("HOLO1")
hololens = Hololens(
    WebsocketObject=wsstart,
    Disable=Button(),
    DeviceName=panel_5,
    SkillConfiguration="{'robot-control': 1, 'screw': 1, 'pick-and-place': 1}")  # -> Output, ARDevice

# ----
# Define Marker
panel_6 = Panel("marker1")
inputdevice = ARInputDevice(WebsocketObject=wsstart, Disable=Button(), DeviceName=panel_6)  # -> Output, ARDevice

# ----
# modify with MCP
# (new cluster)
number_slider = Slider(1, range=0..8)
filter = StreamFilter(Gate=number_slider, Stream1=brep_5)
filter_2 = StreamFilter(Gate=number_slider, Stream1=brep_6)
filter_3 = StreamFilter(Gate=number_slider, Stream1=brep_2)

# ---- group: blue A
brep_13 = Brep(filter_3)

# ---- group: red A
brep_14 = Brep(filter_2)

# ---- group: green A
brep_15 = Brep(filter)

# ----
concat = Concatenate(FragmentA=panel_3, FragmentB="_RedA")
concat_2 = Concatenate(FragmentA=panel_3, FragmentB="_GreenA")
concat_3 = Concatenate(FragmentA=panel_3, FragmentB="_BlueA")
cluster = Cluster(M=brep_15, txt=concat_2, col=ColourSwatch(SwatchColor=RGB(78, 169, 77)), data=inputdevice.ARDevice)
cluster_2 = Cluster(M=brep_14, txt=concat, col=ColourSwatch(SwatchColor=RGB(181, 62, 53)), data=inputdevice.ARDevice)
cluster_3 = Cluster(M=brep_13, txt=concat_3, col=ColourSwatch(SwatchColor=RGB(23, 0, 212)), data=inputdevice.ARDevice)
merge = Merge(Data1=cluster, Data2=cluster_2, Data3=cluster_3)

pln = Plane(xy)
pln_2 = Plane(xy_2)
cluster_4 = Cluster_2(data=robot.RobotObject, pln=pln, pln_2=pln_2, B=brep_15)
cluster_5 = Cluster_2(data=robot.RobotObject, pln=pln, pln_2=pln_2, B=brep_14)
cluster_6 = Cluster_2(data=robot.RobotObject, pln=pln, pln_2=pln_2, B=brep_13)
merge_2 = Merge(Data1=cluster_4, Data2=cluster_5, Data3=cluster_6)

human_task_name = Panel("""Place Beam 1
Place Beam 2
Place Beam 3""")
robot_task_name = Panel("""Pick up beam
Place beam
Ready Next""")
data = Data(hololens.ARDevice)
data_2 = Data(robot.RobotObject)
task = ConstructTaskObject(TaskNames=human_task_name, TargetDevices=data, SceneContents=merge, AssociatedSkill="null", EstimatedDuration=60)  # -> Output, TaskObject
task_2 = ConstructTaskObject(
    TaskNames=robot_task_name,
    TargetDevices=data_2,
    SceneContents=merge,
    RobotTrajectory=merge_2,
    AssociatedSkill="null",
    EstimatedDuration=60)  # -> Output, TaskObject

# ----
# modify with MCP
# (design -> fabricate)
start = BooleanToggle(False)
remove = BooleanToggle(False)
update = BooleanToggle(True)

# ----
# modify with MCP
# (task assign)
python = GhPythonScript(manual=task.TaskObject, robot=task_2.TaskObject)  # -> out, tasks
# ---------- python: Python ----------
__author__ = "cxy201"
__version__ = "2025.06.16"

import rhinoscriptsyntax as rs

# script here will pick the right actor and output tasks

tasks = manual
# ---------- end python ----------

# ----
# Gaze Target
# Send to HoloLens
online = BooleanToggle(False)
gazetracker = GazeTracker(Online=online, ARDevice=data)
scene_model = XRSceneModel(GHControl=True, ARDevices=data, ContentObjects=merge, TriggerSend=update, TriggerRemove=remove, TimeDelay=100)
panel_7 = Panel(gazetracker)
panel_8 = Panel(scene_model)

# ----
# Task Execution
taskctrl = TaskController(Start=start, HRCTasks=python.tasks, GHControl=True)  # -> CurrentTask, ProcessLog
panel_9 = Panel(taskctrl.ProcessLog)

# ==== cluster Cluster
txt = ClusterInput()
col = ClusterInput()
data = ClusterInput()
M = ClusterInput()
col_2 = Colour(col)
data_2 = Data(data)
txt_2 = Text(txt)
yz = YZPlane(Origin=Point(0, 0, 0))
concat = Concatenate(FragmentA="dynamic_", FragmentB=txt_2)
mesh = SceneMeshObject(TargetAnchor=data_2, Meshes=M, Names=concat, Colours=col_2, DisplayRules="session")  # -> Output, MeshGeometryObjects
# Create Content Object
text = SceneTextObject(TargetAnchor=data_2, Texts=txt_2, Planes=yz, Names=txt_2, Colours=col_2, Solid=False, DisplayRules="session")  # -> Output, TextObjects
split = TextSplit(Text=txt_2, Separators="_")
item = ListItem(List=split, Index=0, Wrap=True)  # -> Item, Item1
content = ConstructSceneContent(Name=item.Item1, Meshes=mesh.MeshGeometryObjects, Texts=text.TextObjects, LevelOfDetail=0)  # -> flatten(ContentObject)
content_2 = ClusterOutput(content)

# ==== cluster Cluster_2
data = ClusterInput()
pln = ClusterInput()
pln_2 = ClusterInput()
B = ClusterInput()
data_2 = Data(data)

# ---- group: placement point
debrep = DeconstructBrep(Brep=B)  # -> Faces, Edges, Vertices
item = ListItem(List=debrep.Faces, Index=0, Wrap=True)
area = Area(Geometry=item)  # -> Area, Centroid
debrep_2 = DeconstructBrep(Brep=item)  # -> Faces, Edges, Vertices
item_2 = ListItem(List=debrep_2.Edges, Index=0, Wrap=True)  # -> Item, Item1
pl = ConstructPlane(Origin=area.Centroid, XAxis=item_2.Item, YAxis=item_2.Item1)

# ---- group: home
pln_3 = Plane(pln)

# ---- group: pickup point
pln_4 = Plane(pln_2)

# ----
z_offset = Slider(0.5, range=0..1)
Z = UnitZ(Factor=z_offset)
move = Move(Geometry=pl, Motion=Z)  # -> Geometry, Transform
toggle = BooleanToggle(True)
merge = Merge(Data1=pln_3, Data2=pln_4)  # -> flatten(Result)
merge_2 = Merge(Data1=move.Geometry, Data2=pl, Data3=move.Geometry)  # -> flatten(Result)
merge_3 = Merge(Data1=move.Geometry, Data2=pln_3)  # -> flatten(Result)
trajectory = RobotTrajectoryObject(TargetRobot=data_2, IsCartesian=toggle, TCPFrames=merge, TrajectoryWidth=0.01)  # -> Output, TrajectoryObject, TrajectoryMesh
trajectory_2 = RobotTrajectoryObject(TargetRobot=data_2, IsCartesian=toggle, TCPFrames=merge_3, TrajectoryWidth=0.01)  # -> Output, TrajectoryObject, TrajectoryMesh
trajectory_3 = RobotTrajectoryObject(TargetRobot=data_2, IsCartesian=toggle, TCPFrames=merge_2, TrajectoryWidth=0.01)  # -> Output, TrajectoryObject, TrajectoryMesh
merge_4 = Merge(Data1=trajectory.TrajectoryObject, Data2=trajectory_3.TrajectoryObject, Data3=trajectory_2.TrajectoryObject)
R = ClusterOutput(merge_4)
