# Grasshopper definition design agent test.gh (Grasshopper 1.0.8)
# plug-ins: GH_MCP, Sandbox Topology, Weaverbird

file_path = FilePath("C:\Users\zzyal\Documents\GitHub\DF2025_Vizor_agents\src\bridge_design_system\data\all_categories.json")  # disabled
python_3_script = Python3Script(x=file_path)  # -> out, a; disabled
# ---------- python_3_script: Python ----------
import json
import Rhino.Geometry as rg

def load_and_layout(filepath, spacing_factor=0.4, row_spacing_factor=0.6, min_spacing=0.02):
    filepath = filepath.replace("\\", "/")

    try:
        with open(filepath, 'r') as f:
            data = json.load(f)
    except Exception as e:
        print("读取 JSON 文件失败:", e)
        return []

    curves = []
    shape_type_list = list(data.keys())
    y_cursor = 0

    for shape_type in shape_type_list:
        shape_list = data[shape_type]
        x_cursor = 0
        max_row_height = 0

        for item in shape_list:
            verts = item.get("vertices", [])
            if len(verts) >= 3:
                base_pts = [rg.Point3d(x, y, 0) for x, y in verts]
                if base_pts[0] != base_pts[-1]:
                    base_pts.append(base_pts[0])

                polyline = rg.Polyline(base_pts)
                if not polyline.IsValid:
                    continue

                bbox = rg.BoundingBox(base_pts)
                width = bbox.Diagonal.X
                height = bbox.Diagonal.Y

                spacing = max(width * spacing_factor, min_spacing)

                # 更新当前行最大高度
                max_row_height = max(max_row_height, height)

                # 将图形从 bbox.Min 对齐到 x_cursor/y_cursor 起始点
                move_vec = rg.Vector3d(x_cursor - bbox.Min.X, y_cursor - bbox.Min.Y, 0)
                moved_pts = [pt + move_vec for pt in base_pts]
                moved_poly = rg.Polyline(moved_pts)
                curves.append(moved_poly.ToNurbsCurve())

                x_cursor += width + spacing

        # 每一类结束后换行：往下移动当前行最大高度
        y_cursor -= max_row_height * (1 + row_spacing_factor)

    return curves

# 主入口
a = load_and_layout(x)
# ---------- end python_3_script ----------
python_3_script_2 = Python3Script(x=file_path)  # -> out, a, b; disabled
# ---------- python_3_script_2: Python ----------
import json
import Rhino.Geometry as rg

def load_shapes(filepath):
    filepath = filepath.replace("\\", "/")  # 兼容 Windows 路径

    try:
        with open(filepath, 'r') as f:
            data = json.load(f)
    except Exception as e:
        print("读取 JSON 文件失败:", e)
        return [], []

    triangles = []
    hexagons = []

    # 处理 triangle 数据
    for item in data.get("triangle", []):
        verts = item.get("vertices", [])
        pos = item.get("position", [0, 0, 0])
        if len(verts) >= 3:
            pts = [rg.Point3d(x + pos[0], y + pos[1], pos[2]) for x, y in verts]
            if pts[0] != pts[-1]:
                pts.append(pts[0])  # 闭合
            polyline = rg.Polyline(pts)
            if polyline.IsValid:
                triangles.append(polyline.ToNurbsCurve())

    # 处理 hexagon 数据
    for item in data.get("hexagon", []):
        verts = item.get("vertices", [])
        pos = item.get("position", [0, 0, 0])
        if len(verts) >= 3:
            pts = [rg.Point3d(x + pos[0], y + pos[1], pos[2]) for x, y in verts]
            if pts[0] != pts[-1]:
                pts.append(pts[0])  # 闭合
            polyline = rg.Polyline(pts)
            if polyline.IsValid:
                hexagons.append(polyline.ToNurbsCurve())

    return triangles, hexagons

# x 是文件路径输入
a, b = load_shapes(x)
# ---------- end python_3_script_2 ----------
boundary_surfaces = BoundarySurfaces(Edges=python_3_script_2.a)  # disabled
boundary_surfaces_2 = BoundarySurfaces(Edges=python_3_script_2.b)  # disabled
curve = Curve(python_3_script.a)  # disabled
curve_2 = Curve([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])
boundary_surfaces_3 = BoundarySurfaces(Edges=curve)  # disabled

# ---- group: LS
item = ListItem(List=curve_2, Index=0, Wrap=True)
boundary = BoundarySurfaces(Edges=item)
area = Area(Geometry=curve_2)  # -> Area, Centroid
points = PointList(Points=area.Centroid, Size=2)
del = DelaunayMesh(Points=area.Centroid, Plane=PlaneXY(0, 0, 0))
mesh_topo_vertex = MeshTopologyVertex(Mesh=del)  # -> ListOfMeshVertices, VertexVertexStructure, VertexFaceStructure
cp = ClosestPoint(Point=area.Centroid, Cloud=mesh_topo_vertex.ListOfMeshVertices)  # -> ClosestPoint, CPIndex, Distance
item_2 = ListItem(List=mesh_topo_vertex.ListOfMeshVertices, Index=mesh_topo_vertex.VertexVertexStructure, Wrap=True)
item_3 = ListItem(List=curve_2, Index=cp.CPIndex, Wrap=True)
item_4 = ListItem(List=curve_2, Index=mesh_topo_vertex.VertexVertexStructure, Wrap=True)
item_5 = ListItem(List=curve_2, Index=mesh_topo_vertex.VertexVertexStructure, Wrap=True)
lng = ListLength(List=item_4)
disc = Discontinuity(Curve=curve_2, Level=1)  # -> Points, Parameters
group = Group(Geometry=item_4)
dup = DuplicateData(Data=graft(item_3), Number=lng, Order=True)
lng_2 = ListLength(List=disc.Points)
dup_2 = DuplicateData(Data=group, Number=lng_2, Order=True)
ungroup = Ungroup(Group=dup_2)
crv_cp = CurveClosestPoint(Point=graft(disc.Points), Curve=simplify(ungroup))  # -> Point, Parameter, Distance
sort = SortList(Keys=crv_cp.Distance, ValuesA=crv_cp.Point)  # -> Keys, ValuesA
item_6 = ListItem(List=sort.ValuesA, Index=0, Wrap=True)
ln = Line(StartPoint=graft(disc.Points), EndPoint=item_6)
trim = TrimTree(Tree=ln, Depth=1)
ccx = CurveCurve(CurveA=graft(curve_2), CurveB=trim)  # -> Points, ParamsA, ParamsB
boundary_2 = BoundarySurfaces(Edges=curve_2)
lng_3 = ListLength(List=ccx.Points)
larger = LargerThan(FirstNumber=lng_3, SecondNumber=1)  # -> LargerThan, OrEqualTo
cull = CullPattern(List=ln, CullPattern=invert(larger.LargerThan))

# ---- group: Create Meshes
curve_3 = Curve(cull)
curve_4 = Curve(curve_2)
end_points = EndPoints(Curve=curve_3)  # -> Start, End
merge = Merge(Data1=end_points.Start, Data2=end_points.End)
point_in_curve = PointInCurve(Point=flatten(merge), Curve=graft(curve_4))  # -> simplify(Relationship), Point
equality = Equality(FirstNumber=point_in_curve.Relationship, SecondNumber="1")  # -> Equality, Inequality
cull_pattern = CullPattern(List=flatten(merge), CullPattern=equality.Equality)
curve_5 = Curve(simplify(graft(curve_4)))
curve_closest_point = CurveClosestPoint(Point=cull_pattern, Curve=graft(curve_5))  # -> Point, simplify(Parameter), Distance
shatter = Shatter(Curve=curve_5, Parameters=curve_closest_point.Parameter)
join_curves = JoinCurves(Curves=shatter, Preserve=False)  # -> simplify(Curves)
curve_6 = Curve(join_curves)
explode = Explode(Curve=curve_6, Recursive=True)  # -> Segments, Vertices
area_2 = Area(Geometry=curve_6)  # -> Area, Centroid
line = Line(StartPoint=explode.Vertices, EndPoint=area_2.Centroid)
merge_2 = Merge(Data1=line, Data2=explode.Segments)
weaverbird_s_mesh_from_lines_weave_back = WeaverbirdsMeshFromLinesWeaveBack(Lines=merge_2, MaximumValence=4)

# ----
point = Point(merge)
mesh = Mesh(flatten(weaverbird_s_mesh_from_lines_weave_back))
curve_7 = Curve(flatten(curve_3))
deconstruct_mesh = DeconstructMesh(Mesh=mesh)  # -> Vertices, Faces, Colours, Normals

# ---- group: geometry_agent
seed = Python3Script()  # -> out, a
# ---------- seed: Python ----------
#! python 3

# ! python 3

# ――― choose / compute your number ―――
value_to_send = 2        # or any calculation that yields a float/int

# ――― push it to the output ―――
a = value_to_send           # ‘a’ is the named output parameter
# ---------- end seed ----------
anchornumber = Python3Script()  # -> out, a
# ---------- anchornumber: Python ----------
#! python 3

# ! python 3

# ――― choose / compute your number ―――
value_to_send = 12        # or any calculation that yields a float/int

# ――― push it to the output ―――
a = value_to_send           # ‘a’ is the named output parameter
# ---------- end anchornumber ----------

# ---- group: Anchors
number_slider = Slider(32, range=0..100)
number_slider_2 = Slider(2, range=0..10)
point_2 = Point(flatten(merge))
list_length = ListLength(List=point_2)  # -> expr("x-1", Length)
construct_domain = ConstructDomain(DomainStart=0, DomainEnd=list_length)
random = Random(Range=construct_domain, Number=anchornumber.a, Seed=seed.a)
list_item = ListItem(List=point_2, Index=random, Wrap=True)
anchor = Anchor(Point=list_item, Strength=10000)

# ---- group: Planar Cardboard Pieces
mesh_edges = MeshEdges(Mesh=mesh)  # -> NakedEdges, InteriorEdges, NonManifoldEdges
coplanar = CoPlanar(Points=deconstruct_mesh.Vertices, Strength=Slider(1000, range=0..1000))  # -> flatten(Coplanar)
length_line = LengthLine(Line=[mesh_edges.NakedEdges, mesh_edges.InteriorEdges], Strength="1000")

# ---- group: Gravity
unit_z = UnitZ(Factor=1)
negative = Negative(Value=unit_z)
load = Load(Point=deconstruct_mesh.Vertices, ForceVector=negative, Weighting=Slider(0.26, range=0..10))

# ---- group: "Tape"
length_line_2 = LengthLine(Line=curve_7, Strength=Slider(1000, range=0..1000))

# ----
show = Show(G=[curve_7, mesh])
entwine = Entwine(
    Branch00=show,
    Branch01=length_line_2,
    Branch03=load,
    Branch04=anchor,
    Branch06=length_line,
    Branch07=coplanar,
    FlattenInputs=True)  # -> flatten(Result)
boolean_toggle = BooleanToggle(True)  # disabled
button = Button()  # disabled
zombiesolver = ZombieSolver(GoalObjects=entwine, Threshold=1e-10, Tolerance=0.0001, MaxIterations="30000")  # -> I, V, O
bouncysolver = BouncySolver(GoalObjects=entwine, Reset=button, Threshold=1e-15, Tolerance=0.0001, Damping=0.99, Iterations=10, On=boolean_toggle)  # -> I, V, O; disabled
point_3 = Point(zombiesolver.V)
grasshopper_mcp = GrasshopperMCP(Enabled=Toggle(True), Port=8081, Address="0.0.0.0")  # -> Status, LastCommand
panel = Panel(zombiesolver.O)
panel_2 = Panel("149")  # disabled
split_list = SplitList(List=bouncysolver.O, Index=panel_2)  # -> ListA, ListB; disabled
colour_swatch = ColourSwatch(SwatchColor=RGB(199, 199, 199))  # disabled
data = Data(split_list.ListA)  # disabled
custom_preview = CustomPreview(Geometry=data, Material=colour_swatch)  # disabled
