# Grasshopper definition geometr preview.gh (Grasshopper 1.0.8)

file_path = FilePath("C:\Users\zzyal\Documents\GitHub\DF2025_Vizor_agents\src\bridge_design_system\data\all_categories.json")
python_3_script = Python3Script(x=file_path)  # -> out, a
# ---------- python_3_script: Python ----------
import json
import Rhino.Geometry as rg

def load_and_layout(filepath, spacing_factor=0.4, row_spacing_factor=0.6, min_spacing=0.02):
    filepath = filepath.replace("\\", "/")

    try:
        with open(filepath, 'r') as f:
            data = json.load(f)
    except Exception as e:
        print("读取 JSON 文件失败:", e)
        return []

    curves = []
    shape_type_list = list(data.keys())
    y_cursor = 0

    for shape_type in shape_type_list:
        shape_list = data[shape_type]
        x_cursor = 0
        max_row_height = 0

        for item in shape_list:
            verts = item.get("vertices", [])
            if len(verts) >= 3:
                base_pts = [rg.Point3d(x, y, 0) for x, y in verts]
                if base_pts[0] != base_pts[-1]:
                    base_pts.append(base_pts[0])

                polyline = rg.Polyline(base_pts)
                if not polyline.IsValid:
                    continue

                bbox = rg.BoundingBox(base_pts)
                width = bbox.Diagonal.X
                height = bbox.Diagonal.Y

                spacing = max(width * spacing_factor, min_spacing)

                # 更新当前行最大高度
                max_row_height = max(max_row_height, height)

                # 将图形从 bbox.Min 对齐到 x_cursor/y_cursor 起始点
                move_vec = rg.Vector3d(x_cursor - bbox.Min.X, y_cursor - bbox.Min.Y, 0)
                moved_pts = [pt + move_vec for pt in base_pts]
                moved_poly = rg.Polyline(moved_pts)
                curves.append(moved_poly.ToNurbsCurve())

                x_cursor += width + spacing

        # 每一类结束后换行：往下移动当前行最大高度
        y_cursor -= max_row_height * (1 + row_spacing_factor)

    return curves

# 主入口
a = load_and_layout(x)
# ---------- end python_3_script ----------
python_3_script_2 = Python3Script(x=file_path)  # -> out, a, b
# ---------- python_3_script_2: Python ----------
import json
import Rhino.Geometry as rg

def load_shapes(filepath):
    filepath = filepath.replace("\\", "/")  # 兼容 Windows 路径

    try:
        with open(filepath, 'r') as f:
            data = json.load(f)
    except Exception as e:
        print("读取 JSON 文件失败:", e)
        return [], []

    triangles = []
    hexagons = []

    # 处理 triangle 数据
    for item in data.get("triangle", []):
        verts = item.get("vertices", [])
        pos = item.get("position", [0, 0, 0])
        if len(verts) >= 3:
            pts = [rg.Point3d(x + pos[0], y + pos[1], pos[2]) for x, y in verts]
            if pts[0] != pts[-1]:
                pts.append(pts[0])  # 闭合
            polyline = rg.Polyline(pts)
            if polyline.IsValid:
                triangles.append(polyline.ToNurbsCurve())

    # 处理 hexagon 数据
    for item in data.get("hexagon", []):
        verts = item.get("vertices", [])
        pos = item.get("position", [0, 0, 0])
        if len(verts) >= 3:
            pts = [rg.Point3d(x + pos[0], y + pos[1], pos[2]) for x, y in verts]
            if pts[0] != pts[-1]:
                pts.append(pts[0])  # 闭合
            polyline = rg.Polyline(pts)
            if polyline.IsValid:
                hexagons.append(polyline.ToNurbsCurve())

    return triangles, hexagons

# x 是文件路径输入
a, b = load_shapes(x)
# ---------- end python_3_script_2 ----------
boundary_surfaces = BoundarySurfaces(Edges=python_3_script_2.a)
boundary_surfaces_2 = BoundarySurfaces(Edges=python_3_script_2.b)
curve = Curve(python_3_script.a)
boundary_surfaces_3 = BoundarySurfaces(Edges=curve)
