# Grasshopper definition 250624_workflow_test.gh (Grasshopper 1.0.8)
# plug-ins: GH_MCP, Virtual Robot, Vizor

# ---- group: geometry_agent
component_4 = Python3Script()  # -> out, a, b, c
# ---------- component_4: Python ----------
#! python 3

import Rhino.Geometry as rg
import math
import System.Drawing

# ---------------------------------------------------------------------------
# CLASS DEFINITION
# This is the "blueprint" for our AssemblyElement objects.
# START of :DO NOT TOUCH THIS CODE
# ---------------------------------------------------------------------------
class AssemblyElement:
    def __init__(self, id, type, center_point, direction, length, width=0.05, height=0.05):
        """
        Initializes the element.
        direction: Unit vector for orientation (will be normalized)
        length: Explicit length of the beam
        """
        # Make a copy of the direction vector and ensure it's horizontal
        dir_vector = rg.Vector3d(direction.X, direction.Y, 0)  # Copy and flatten to XY plane
        dir_vector.Unitize()  # Make it a unit vector
        
        # --- Class Properties ---
        self.id = id
        self.type = type
        self.center_point = center_point
        self.direction = dir_vector  # Unit vector for orientation
        self.length = length  # Explicit length
        self.vector = dir_vector * length  # Full vector for geometry creation
        self.width = width
        self.height = height
        self.geometry = self._create_box_geometry()
    
    def _create_box_geometry(self):
        """
        A private helper method to create the 3D Box geometry for the element,
        ensuring it is correctly oriented and dimensioned.
        """
        if self.length == 0: return None

        x_axis = self.vector
        y_axis = rg.Vector3d.CrossProduct(rg.Vector3d.ZAxis, x_axis)
        plane = rg.Plane(self.center_point, x_axis, y_axis)
        x_interval = rg.Interval(-self.length / 2.0, self.length / 2.0)
        y_interval = rg.Interval(-self.width / 2.0, self.width / 2.0)
        z_interval = rg.Interval(-self.height / 2.0, self.height / 2.0)
        return rg.Box(plane, x_interval, y_interval, z_interval)

# END of: DO NOT TOUCH THIS CODE
# ---------------------------------------------------------------------------
# AGENT DEFINITION SECTION => you can edit this part.
# Here, each of the three beams is defined individually and explicitly.
# This section is unchanged.
# This component is variant B 
# ---------------------------------------------------------------------------
# START of : EDIT the code here

assembly_elements = []

# --- BEAM 1 Level 1 ---
center1 = rg.Point3d(2.4428, -0.0996, 0.025)
direction1 = rg.Vector3d(34.48, -19.91, 0)
length1 = 0.40
beam1 = AssemblyElement(id="031", type="green_b", center_point=center1, 
                        direction=direction1, length=length1, width=0.05, height=0.05)
assembly_elements.append(beam1)

# --- BEAM 2 on Level 1 ---
center2 = rg.Point3d(2.0677, -0.0996, 0.025)
direction2 = rg.Vector3d(-34.48, -19.91, 0)
length2 = 0.40
beam2 = AssemblyElement(id="032", type="red_b", center_point=center2, 
                        direction=direction2, length=length2, width=0.05, height=0.05)
assembly_elements.append(beam2)

# --- BEAM 3 Level 2 ---
center3 = rg.Point3d(1.8718, -0.01, 0.075)
direction3 = rg.Vector3d(83.98, 0, 0)
length3 = 0.84
beam3 = AssemblyElement(id="033", type="blue_b", center_point=center3, 
                        direction=direction3, length=length3, width=0.05, height=0.05)
assembly_elements.append(beam3)

# --- BEAM 4 Level 3 ---
center4 = rg.Point3d(1.1551, -0.01, 0.125)
direction4 = rg.Vector3d(83.98, 0, 0)
length4 = 0.84
beam4 = AssemblyElement(id="034", type="orange_b", center_point=center4, 
                        direction=direction4, length=length4, width=0.05, height=0.05)
assembly_elements.append(beam4)

# ===========================================================================
# AGENT EDIT THIS SECTION when asked update/rationalize the geometry run the, `get_all_components_enhanced` and identify the ID of the component named "TRANSFORMATION_VECTOR", then run `get_component_info_enhanced` tool to extract the data. 
# Add the key value pairs to the dictionary bellow.
# Important: Remember to match the element's 'level' to the one in its base deifnition above
# Example: transformations = {
    #"023": rg.Transform.PlaneToPlane(rg.Plane(rg.Point3d(1.5415, -0.1792, 0.075), rg.Vector3d(1.0, 0.0, 0.0), rg.Vector3d(0.0, 1.0, 0.0)), rg.Plane(rg.Point3d(1.5792, -0.1583, 0.075), rg.Vector3d(0.99, 0.02, 0.0), rg.Vector3d(-0.02, 0.99, 0.0))),
#   }
# ===========================================================================
transformations = {
    # This block is waiting for the LLM agent.
}

# END of: EDIT the code here

# ===========================================================================
# APPLY TRANSFORMATIONS
# ===========================================================================
for element in assembly_elements:
    if element.id in transformations:
        transform_to_apply = transformations[element.id]
        element.geometry.Transform(transform_to_apply)
        
# ---------------------------------------------------------------------------
# Define colors based on element type
# ---------------------------------------------------------------------------
display_colors = []
for element in assembly_elements:
    if element.type == "green_b":
        # System.Drawing.Color.FromName takes a string name
        color = System.Drawing.Color.Green 
    elif element.type == "red_b":
        # You can also define colors by their RGB values (0-255)
        color = System.Drawing.Color.Red
    elif element.type == "blue_b":
        # You can also define colors by their RGB values (0-255)
        color = System.Drawing.Color.Blue
    elif element.type == "orange_b":
        color = System.Drawing.Color.Orange
    else:
        # A default color for any other type
        color = System.Drawing.Color.Gray
    display_colors.append(color)

# ---------------------------------------------------------------------------
# OUTPUT
# This part sends the final geometry and colors to the Grasshopper component outputs.
# ---------------------------------------------------------------------------
a = [element.geometry for element in assembly_elements]
b = display_colors 
c = [element.id for element in assembly_elements]
# ---------- end component_4 ----------
component_3 = Python3Script()  # -> out, a, b, c
# ---------- component_3: Python ----------
#! python 3

import Rhino.Geometry as rg
import math
import System.Drawing

# ---------------------------------------------------------------------------
# CLASS DEFINITION
# This is the "blueprint" for our AssemblyElement objects.
# DO NOT TOUCH THIS CODE
# ---------------------------------------------------------------------------
class AssemblyElement:
    def __init__(self, id, type, center_point, direction, length, width=0.05, height=0.05):
        """
        Initializes the element.
        direction: Unit vector for orientation (will be normalized)
        length: Explicit length of the beam
        """
        # Make a copy of the direction vector and ensure it's horizontal
        dir_vector = rg.Vector3d(direction.X, direction.Y, 0)  # Copy and flatten to XY plane
        dir_vector.Unitize()  # Make it a unit vector
        
        # --- Class Properties ---
        self.id = id
        self.type = type
        self.center_point = center_point
        self.direction = dir_vector  # Unit vector for orientation
        self.length = length  # Explicit length
        self.vector = dir_vector * length  # Full vector for geometry creation
        self.width = width
        self.height = height
        self.geometry = self._create_box_geometry()
    
    def _create_box_geometry(self):
        """
        A private helper method to create the 3D Box geometry for the element,
        ensuring it is correctly oriented and dimensioned.
        """
        if self.length == 0: return None

        x_axis = self.vector
        y_axis = rg.Vector3d.CrossProduct(rg.Vector3d.ZAxis, x_axis)
        plane = rg.Plane(self.center_point, x_axis, y_axis)
        x_interval = rg.Interval(-self.length / 2.0, self.length / 2.0)
        y_interval = rg.Interval(-self.width / 2.0, self.width / 2.0)
        z_interval = rg.Interval(-self.height / 2.0, self.height / 2.0)
        return rg.Box(plane, x_interval, y_interval, z_interval)

# END of: DO NOT TOUCH THIS CODE
# ---------------------------------------------------------------------------
# AGENT DEFINITION SECTION => you can edit this part.
# Here, each of the three beams is defined individually and explicitly.
# This section is unchanged.
# This component is variant A - it looks like a triangle
# ---------------------------------------------------------------------------
# START of : EDIT the code here

assembly_elements = []

# --- BEAM 1: Beam on Level 1 ---
center1 = rg.Point3d(1.3124, -0.10, 0.025)
direction1 = rg.Vector3d(-34.48, -19.91, 0)
length1 = 0.40
beam1 = AssemblyElement(id="021", type="green_a", center_point=center1, 
                        direction=direction1, length=length1, width=0.05, height=0.05)
assembly_elements.append(beam1)

# --- BEAM 2: Beam on Level 1 ---
center2 = rg.Point3d(1.6888, -0.10, 0.025)
direction2 = rg.Vector3d(34.48, -19.91, 0)
length2 = 0.40
beam2 = AssemblyElement(id="022", type="red_a", center_point=center2, 
                        direction=direction2, length=length2, width=0.05, height=0.05)
assembly_elements.append(beam2)

# --- BEAM 3: beams on Level 2 ---
center3 = rg.Point3d(1.5115, -0.1792, 0.075)
direction3 = rg.Vector3d(85.0, 0, 0)
length3 = 0.85
beam3 = AssemblyElement(id="023", type="blue_a", center_point=center3, 
                        direction=direction3, length=length3, width=0.05, height=0.05)
assembly_elements.append(beam3)

# --- BEAM 4: beams on Level 3 ---
center4 = rg.Point3d(0.7847, -0.1792, 0.125)
direction4 = rg.Vector3d(80.0, 0, 0)
length4 = 0.80
beam4 = AssemblyElement(id="024", type="orange_a", center_point=center4, 
                        direction=direction4, length=length4, width=0.05, height=0.05)
assembly_elements.append(beam4)

# ===========================================================================
# AGENT EDIT THIS SECTION when asked update/rationalize the geometry run the, `get_all_components_enhanced` and identify the ID of the component named "TRANSFORMATION_VECTOR", then run `get_component_info_enhanced` tool to extract the data. 
# Add the key value pairs to the dictionary bellow.
# Important: Remember to match the element's 'level' to the one in its base deifnition above
# Example: transformations = {
    #"023": rg.Transform.PlaneToPlane(rg.Plane(rg.Point3d(1.5115, -0.1792, 0.075), rg.Vector3d(1.0, 0.0, 0.0), rg.Vector3d(0.0, 1.0, 0.0)), rg.Plane(rg.Point3d(1.5492, -0.1583, 0.075), rg.Vector3d(0.99, 0.02, 0.0), rg.Vector3d(-0.02, 0.99, 0.0))),
#   }
# ===========================================================================
transformations = {
    # This block is waiting for the LLM agent.
}

# END of: EDIT the code here

# ===========================================================================
# APPLY TRANSFORMATIONS
# ===========================================================================
for element in assembly_elements:
    if element.id in transformations:
        transform_to_apply = transformations[element.id]
        element.geometry.Transform(transform_to_apply)
        
# ---------------------------------------------------------------------------
# Define colors based on element type
# ---------------------------------------------------------------------------
display_colors = []
for element in assembly_elements:
    if element.type == "green_a":
        # System.Drawing.Color.FromName takes a string name
        color = System.Drawing.Color.Green 
    elif element.type == "red_a":
        # You can also define colors by their RGB values (0-255)
        color = System.Drawing.Color.Red
    elif element.type == "blue_a":
        color = System.Drawing.Color.Blue
    elif element.type == "orange_a":
        color = System.Drawing.Color.Orange
    else:
        # A default color for any other type
        color = System.Drawing.Color.Gray
    display_colors.append(color)

# ---------------------------------------------------------------------------
# OUTPUT
# This part sends the final geometry and colors to the Grasshopper component outputs.
# ---------------------------------------------------------------------------
a = [element.geometry for element in assembly_elements]
b = display_colors 
c = [element.id for element in assembly_elements]
# ---------- end component_3 ----------

# ----
# Component 1
component_1 = Python3Script()  # -> out, a, b, c
# ---------- component_1: Python ----------
#! python 3

import Rhino.Geometry as rg
import math
import System.Drawing

# ---------------------------------------------------------------------------
# CLASS DEFINITION
# This is the "blueprint" for our AssemblyElement objects.
# DO NOT TOUCH THIS CODE
# ---------------------------------------------------------------------------
class AssemblyElement:
    # The default values for width and height are now scaled to meters.
    def __init__(self, id, type, center_point, direction, length, width=0.05, height=0.05):
        """
        Initializes the element.
        direction: Unit vector for orientation (will be normalized)
        length: Explicit length of the beam
        """
        # Make a copy of the direction vector and ensure it's horizontal
        dir_vector = rg.Vector3d(direction.X, direction.Y, 0)  # Copy and flatten to XY plane
        dir_vector.Unitize()  # Make it a unit vector
        
        # --- Class Properties ---
        self.id = id
        self.type = type
        self.center_point = center_point
        self.direction = dir_vector  # Unit vector for orientation
        self.length = length  # Explicit length
        self.vector = dir_vector * length  # Full vector for geometry creation
        self.width = width
        self.height = height
        self.geometry = self._create_box_geometry()
    
    def _create_box_geometry(self):
        """
        A private helper method to create the 3D Box geometry for the element,
        ensuring it is correctly oriented and dimensioned.
        """
        if self.length == 0: return None

        x_axis = self.vector
        y_axis = rg.Vector3d.CrossProduct(rg.Vector3d.ZAxis, x_axis)
        plane = rg.Plane(self.center_point, x_axis, y_axis)
        x_interval = rg.Interval(-self.length / 2.0, self.length / 2.0)
        y_interval = rg.Interval(-self.width / 2.0, self.width / 2.0)
        z_interval = rg.Interval(-self.height / 2.0, self.height / 2.0)
        return rg.Box(plane, x_interval, y_interval, z_interval)

# END of: DO NOT TOUCH THIS CODE
# ---------------------------------------------------------------------------
# AGENT DEFINITION SECTION => you can edit this part.
# Here, each of the three beams is defined individually and explicitly.
# This section is unchanged.
# This component is variant A* - it looks like a triangle
# ---------------------------------------------------------------------------
# START of : EDIT the code here

assembly_elements = []

# --- BEAM 1: Beam on Level 1 ---
center1 = rg.Point3d(-0.1874, -0.10, 0.025)
direction1 = rg.Vector3d(-34.5, -20, 0)
length1 = 0.40
beam1 = AssemblyElement(id="001", type="green_a", center_point=center1,
                        direction=direction1, length=length1, width=0.05, height=0.05)
assembly_elements.append(beam1)


# --- BEAM 2: Beam on Level 1 ---
center2 = rg.Point3d(0.1874, -0.10, 0.025)
direction2 = rg.Vector3d(34.5, -20, 0)
length2 = 0.40
beam2 = AssemblyElement(id="002", type="red_a", center_point=center2,
                        direction=direction2, length=length2, width=0.05, height=0.05)
assembly_elements.append(beam2)


# --- BEAM 3: beams on Level 2 ---
center3 = rg.Point3d(0.04, -0.1792, 0.075)
direction3 = rg.Vector3d(80.0, 0, 0)
length3 = 0.80
beam3 = AssemblyElement(id="003", type="blue_a", center_point=center3,
                        direction=direction3, length=length3, width=0.05, height=0.05)
assembly_elements.append(beam3)

# ===========================================================================
# AGENT EDIT THIS SECTION when asked update/rationalize the geometry run the, `get_all_components_enhanced` and identify the ID of the component named "TRANSFORMATION_VECTOR", then run `get_component_info_enhanced` tool to extract the data. 
# Add the key value pairs to the dictionary bellow.
# Important: Remember to match the element's 'level' to the one in its base deifnition above
# Example: transformations = {
    #"023": rg.Transform.PlaneToPlane(rg.Plane(rg.Point3d(1.4635, -0.1792, 0.075), rg.Vector3d(1.0, 0.0, 0.0), rg.Vector3d(0.0, 1.0, 0.0)), rg.Plane(rg.Point3d(1.5012, -0.1583, 0.075), rg.Vector3d(0.99, 0.02, 0.0), rg.Vector3d(-0.02, 0.99, 0.0))),
#   }
# ===========================================================================
transformations = {
    # This block is waiting for the LLM agent.
}


# END of: EDIT the code here

# ===========================================================================
# APPLY TRANSFORMATIONS
# ===========================================================================
for element in assembly_elements:
    if element.id in transformations:
        transform_to_apply = transformations[element.id]
        element.geometry.Transform(transform_to_apply)

# ---------------------------------------------------------------------------
# Define colors based on element type
# ---------------------------------------------------------------------------
display_colors = []
for element in assembly_elements:
    if element.type == "green_a":
        # System.Drawing.Color.FromName takes a string name
        color = System.Drawing.Color.Green 
    elif element.type == "red_a":
        # You can also define colors by their RGB values (0-255)
        color = System.Drawing.Color.Red
    elif element.type == "blue_a":
        # You can also define colors by their RGB values (0-255)
        color = System.Drawing.Color.Blue
    else:
        # A default color for any other type
        color = System.Drawing.Color.Gray
    display_colors.append(color)

# ---------------------------------------------------------------------------
# OUTPUT
# This part sends the final geometry and colors to the Grasshopper component outputs.
# ---------------------------------------------------------------------------
a = [element.geometry for element in assembly_elements]
b = display_colors
c = [element.id for element in assembly_elements]
# ---------- end component_1 ----------
item = ListItem(List=component_1.a, Index=0, Wrap=True)  # -> Item, Item1, Item2

# ----
# Component 2
component_2 = Python3Script()  # -> out, a, b, c
# ---------- component_2: Python ----------
#! python 3

import Rhino.Geometry as rg
import math
import System.Drawing

# ---------------------------------------------------------------------------
# CLASS DEFINITION
# This is the "blueprint" for our AssemblyElement objects.
# START of :DO NOT TOUCH THIS CODE
# ---------------------------------------------------------------------------
class AssemblyElement:
    def __init__(self, id, type, center_point, direction, length, width=0.05, height=0.05):
        """
        Initializes the element.
        direction: Unit vector for orientation (will be normalized)
        length: Explicit length of the beam
        """
        # Make a copy of the direction vector and ensure it's horizontal
        dir_vector = rg.Vector3d(direction.X, direction.Y, 0)  # Copy and flatten to XY plane
        dir_vector.Unitize()  # Make it a unit vector
        
        # --- Class Properties ---
        self.id = id
        self.type = type
        self.center_point = center_point
        self.direction = dir_vector  # Unit vector for orientation
        self.length = length  # Explicit length
        self.vector = dir_vector * length  # Full vector for geometry creation
        self.width = width
        self.height = height
        self.geometry = self._create_box_geometry()
    
    def _create_box_geometry(self):
        """
        A private helper method to create the 3D Box geometry for the element,
        ensuring it is correctly oriented and dimensioned.
        """
        if self.length == 0: return None

        x_axis = self.vector
        y_axis = rg.Vector3d.CrossProduct(rg.Vector3d.ZAxis, x_axis)
        plane = rg.Plane(self.center_point, x_axis, y_axis)
        x_interval = rg.Interval(-self.length / 2.0, self.length / 2.0)
        y_interval = rg.Interval(-self.width / 2.0, self.width / 2.0)
        z_interval = rg.Interval(-self.height / 2.0, self.height / 2.0)
        return rg.Box(plane, x_interval, y_interval, z_interval)

# END of: DO NOT TOUCH THIS CODE
# ---------------------------------------------------------------------------
# AGENT DEFINITION SECTION => you can edit this part.
# Here, each of the three beams is defined individually and explicitly.
# This section is unchanged.
# This component is variant B* - it looks like a letter Z
# ---------------------------------------------------------------------------
# START of : EDIT the code here

assembly_elements = []

# --- BEAM 1 Level 1 ---
center1 = rg.Point3d(0.9336, -0.10, 0.025)
direction1 = rg.Vector3d(34.48, -19.91, 0)
length1 = 0.40
beam1 = AssemblyElement(id="011", type="green_b", center_point=center1, 
                        direction=direction1, length=length1, width=0.05, height=0.05)
assembly_elements.append(beam1)

# --- BEAM 2 Level 1 ---
center2 = rg.Point3d(0.5588, -0.10, 0.025)
direction2 = rg.Vector3d(-34.48, -19.91, 0)
length2 = 0.40
beam2 = AssemblyElement(id="012", type="red_b", center_point=center2, 
                        direction=direction2, length=length2, width=0.05, height=0.05)
assembly_elements.append(beam2)

# --- BEAM 3 Level 2 ---
center3 = rg.Point3d(0.3995, -0.01, 0.075)
direction3 = rg.Vector3d(83.98, 0, 0)
length3 = 0.90
beam3 = AssemblyElement(id="013", type="blue_b", center_point=center3, 
                        direction=direction3, length=length3, width=0.05, height=0.05)
assembly_elements.append(beam3)

# ===========================================================================
# AGENT EDIT THIS SECTION when asked update/rationalize the geometry run the, `get_all_components_enhanced` and identify the ID of the component named "TRANSFORMATION_VECTOR", then run `get_component_info_enhanced` tool to extract the data. 
# Add the key value pairs to the dictionary bellow.
# Important: Remember to match the element's 'level' to the one in its base deifnition above
# Example: transformations = {
    #"023": rg.Transform.PlaneToPlane(rg.Plane(rg.Point3d(1.4815, -0.1792, 0.075), rg.Vector3d(1.0, 0.0, 0.0), rg.Vector3d(0.0, 1.0, 0.0)), rg.Plane(rg.Point3d(1.5192, -0.1583, 0.075), rg.Vector3d(0.99, 0.02, 0.0), rg.Vector3d(-0.02, 0.99, 0.0))),
#   }
# ===========================================================================
transformations = {
    # This block is waiting for the LLM agent.
}

# END of: EDIT the code here

# ===========================================================================
# APPLY TRANSFORMATIONS
# ===========================================================================
for element in assembly_elements:
    if element.id in transformations:
        transform_to_apply = transformations[element.id]
        element.geometry.Transform(transform_to_apply)
        
# ---------------------------------------------------------------------------
# Define colors based on element type
# ---------------------------------------------------------------------------
display_colors = []
for element in assembly_elements:
    if element.type == "green_b":
        # System.Drawing.Color.FromName takes a string name
        color = System.Drawing.Color.Green 
    elif element.type == "red_b":
        # You can also define colors by their RGB values (0-255)
        color = System.Drawing.Color.Red
    elif element.type == "blue_b":
        # You can also define colors by their RGB values (0-255)
        color = System.Drawing.Color.Blue
    else:
        # A default color for any other type
        color = System.Drawing.Color.Gray
    display_colors.append(color)

# ---------------------------------------------------------------------------
# OUTPUT
# This part sends the final geometry and colors to the Grasshopper component outputs.
# ---------------------------------------------------------------------------
a = [element.geometry for element in assembly_elements]
b = display_colors 
c = [element.id for element in assembly_elements]
# ---------- end component_2 ----------
item_2 = ListItem(List=component_2.a, Index=0, Wrap=True)  # -> Item, Item1, Item2

preview = CustomPreview(Geometry=component_1.a, Material=component_1.b)
# TESTING NOTE: hey please read me the message: I wish you a great evenin!
toggle = BooleanToggle(True)
preview_2 = CustomPreview(Geometry=component_2.a, Material=component_2.b)

# ----
# Component 3
item_3 = ListItem(List=component_3.a, Index=0, Wrap=True)  # -> Item, Item1, Item2, Item3
preview_3 = CustomPreview(Geometry=component_3.a, Material=component_3.b)

# ----
# Component 4
item_4 = ListItem(List=component_4.a, Index=0, Wrap=True)  # -> Item, Item1, Item2, Item3
preview_4 = CustomPreview(Geometry=component_4.a, Material=component_4.b)

# ----
# Docker Connection
button = Button()
wsstart = WsConnection(Address="ws://127.0.0.1:9090", Reset=button)

# ---- group: home position
xy = XYPlane(Origin=Point(0, 0, 0))

# ---- group: pick up position
# TRANSFORMATION_VECTOR: rg.Plane(rg.Point3d(200.35, -34.92, 7.5), rg.Vector3d(1.0, 0.0, 0.0), rg.Vector3d(0.0, 1.0, 0.0)),
#     rg.Plane(rg.Point3d(150.12, -15.83, 7.5), rg.Vector3d(0.99, 0.4, 0.0), rg.Vector3d(-0.2, 0.99, 0.0))
xy_2 = XYPlane(Origin=Point(0, 0, 0))

# ----
mcp = GrasshopperMCP(Enabled=toggle, Port=8081, Address="0.0.0.0")  # -> Status, LastCommand

# ---- group: blue B
brep = Brep(item_2.Item2)

# ---- group: blue A
brep_2 = Brep(item.Item2)

# ---- group: red B
brep_3 = Brep(item_2.Item1)

# ---- group: green B
brep_4 = Brep(item_2.Item)

# ---- group: green A
brep_5 = Brep(item.Item)

# ---- group: red A
brep_6 = Brep(item.Item1)

# ---- group: Gree / blue B
brep_7 = Brep(item_4.Item2)

# ---- group: Gree / green B
brep_8 = Brep(item_4.Item)

# ---- group: Gree / red B
brep_9 = Brep(item_4.Item1)

# ---- group: Gree / orange B
brep_10 = Brep(item_4.Item3)

# ---- group: blue A
brep_11 = Brep(item_3.Item2)

# ---- group: orange A
brep_12 = Brep(item_3.Item3)

# ---- group: red A
brep_13 = Brep(item_3.Item1)

# ---- group: green A
brep_14 = Brep(item_3.Item)

# ----
# unit 3
panel = Panel("Unit1")

# ----
# unit 1
panel_2 = Panel("Unit1*")

# ----
# unit 2
panel_3 = Panel("Unit2*")

# ---- group: Gree
# unit 4
panel_4 = Panel("Unit2")

# ----
# Define Robot
kuka_kr_210 = PredefinedKUKAKR210Robot(RobRootFrame=PlaneXY(0, 0, 0), variant="R2700")
ur10 = PredefinedUniversalRobotUR10(BaseFrame=PlaneXY(0, 0, 0))
robot = Robot(
    WebsocketObject=wsstart,
    Disable=False,
    RobotName="KUKA",
    VirtualRobotModel=kuka_kr_210,
    AxisToggles=[False, False, False],
    JointNames=["base_link", "link_1", "link_2"])  # -> Output, RobotObject

# ----
# Define AR Clients
panel_5 = Panel("HOLO1")
hololens = Hololens(
    WebsocketObject=wsstart,
    Disable=Button(),
    DeviceName=panel_5,
    SkillConfiguration="{'robot-control': 1, 'screw': 1, 'pick-and-place': 1}")  # -> Output, ARDevice

# ----
# Define Marker
panel_6 = Panel("marker1")
inputdevice = ARInputDevice(WebsocketObject=wsstart, Disable=Button(), DeviceName=panel_6)  # -> Output, ARDevice

# ----
# modify with MCP
# (new cluster)
number_slider = Slider(1, range=0..8)
filter = StreamFilter(Gate=number_slider, Stream1=brep_5)
filter_2 = StreamFilter(Gate=number_slider, Stream1=brep_6)
filter_3 = StreamFilter(Gate=number_slider, Stream1=brep_2)

# ---- group: blue A
brep_15 = Brep(filter_3)

# ---- group: red A
brep_16 = Brep(filter_2)

# ---- group: green A
brep_17 = Brep(filter)

# ----
concat = Concatenate(FragmentA=panel_2, FragmentB="_RedA")
concat_2 = Concatenate(FragmentA=panel_2, FragmentB="_GreenA")
concat_3 = Concatenate(FragmentA=panel_2, FragmentB="_BlueA")
cluster = Cluster(M=brep_17, txt=concat_2, col=ColourSwatch(SwatchColor=RGB(78, 169, 77)), data=inputdevice.ARDevice)
cluster_2 = Cluster(M=brep_16, txt=concat, col=ColourSwatch(SwatchColor=RGB(181, 62, 53)), data=inputdevice.ARDevice)
cluster_3 = Cluster(M=brep_15, txt=concat_3, col=ColourSwatch(SwatchColor=RGB(23, 0, 212)), data=inputdevice.ARDevice)
merge = Merge(Data1=cluster, Data2=cluster_2, Data3=cluster_3)

pln = Plane(xy)
pln_2 = Plane(xy_2)
cluster_4 = Cluster_2(data=robot.RobotObject, pln=pln, pln_2=pln_2, B=brep_17)
cluster_5 = Cluster_2(data=robot.RobotObject, pln=pln, pln_2=pln_2, B=brep_16)
cluster_6 = Cluster_2(data=robot.RobotObject, pln=pln, pln_2=pln_2, B=brep_15)
merge_2 = Merge(Data1=cluster_4, Data2=cluster_5, Data3=cluster_6)

human_task_name = Panel("""Place Beam 1
Place Beam 2
Place Beam 3""")
robot_task_name = Panel("""Pick up beam
Place beam
Ready Next""")
data = Data(hololens.ARDevice)
data_2 = Data(robot.RobotObject)
task = ConstructTaskObject(TaskNames=human_task_name, TargetDevices=data, SceneContents=merge, AssociatedSkill="null", EstimatedDuration=60)  # -> Output, TaskObject
task_2 = ConstructTaskObject(
    TaskNames=robot_task_name,
    TargetDevices=data_2,
    SceneContents=merge,
    RobotTrajectory=merge_2,
    AssociatedSkill="null",
    EstimatedDuration=60)  # -> Output, TaskObject

# ----
# modify with MCP
# (design -> fabricate)
start = BooleanToggle(False)
remove = BooleanToggle(False)
update = BooleanToggle(True)

# ----
# modify with MCP
# (task assign)
python = GhPythonScript(manual=task.TaskObject, robot=task_2.TaskObject)  # -> out, tasks
# ---------- python: Python ----------
__author__ = "cxy201"
__version__ = "2025.06.16"

import rhinoscriptsyntax as rs

# script here will pick the right actor and output tasks

tasks = manual
# ---------- end python ----------

# ----
# Gaze Target
# Send to HoloLens
online = BooleanToggle(False)
gazetracker = GazeTracker(Online=online, ARDevice=data)
scene_model = XRSceneModel(GHControl=True, ARDevices=data, ContentObjects=merge, TriggerSend=update, TriggerRemove=remove, TimeDelay=100)
panel_7 = Panel(gazetracker)
panel_8 = Panel(scene_model)

# ----
# Task Execution
taskctrl = TaskController(Start=start, HRCTasks=python.tasks, GHControl=True)  # -> CurrentTask, ProcessLog
panel_9 = Panel(taskctrl.ProcessLog)

# ==== cluster Cluster
txt = ClusterInput()
col = ClusterInput()
data = ClusterInput()
M = ClusterInput()
col_2 = Colour(col)
data_2 = Data(data)
txt_2 = Text(txt)
yz = YZPlane(Origin=Point(0, 0, 0))
concat = Concatenate(FragmentA="dynamic_", FragmentB=txt_2)
mesh = SceneMeshObject(TargetAnchor=data_2, Meshes=M, Names=concat, Colours=col_2, DisplayRules="session")  # -> Output, MeshGeometryObjects
# Create Content Object
text = SceneTextObject(TargetAnchor=data_2, Texts=txt_2, Planes=yz, Names=txt_2, Colours=col_2, Solid=False, DisplayRules="session")  # -> Output, TextObjects
split = TextSplit(Text=txt_2, Separators="_")
item = ListItem(List=split, Index=0, Wrap=True)  # -> Item, Item1
content = ConstructSceneContent(Name=item.Item1, Meshes=mesh.MeshGeometryObjects, Texts=text.TextObjects, LevelOfDetail=0)  # -> flatten(ContentObject)
content_2 = ClusterOutput(content)

# ==== cluster Cluster_2
data = ClusterInput()
pln = ClusterInput()
pln_2 = ClusterInput()
B = ClusterInput()
data_2 = Data(data)

# ---- group: placement point
debrep = DeconstructBrep(Brep=B)  # -> Faces, Edges, Vertices
item = ListItem(List=debrep.Faces, Index=0, Wrap=True)
area = Area(Geometry=item)  # -> Area, Centroid
debrep_2 = DeconstructBrep(Brep=item)  # -> Faces, Edges, Vertices
item_2 = ListItem(List=debrep_2.Edges, Index=0, Wrap=True)  # -> Item, Item1
pl = ConstructPlane(Origin=area.Centroid, XAxis=item_2.Item, YAxis=item_2.Item1)

# ---- group: home
pln_3 = Plane(pln)

# ---- group: pickup point
pln_4 = Plane(pln_2)

# ----
z_offset = Slider(0.5, range=0..1)
Z = UnitZ(Factor=z_offset)
move = Move(Geometry=pl, Motion=Z)  # -> Geometry, Transform
toggle = BooleanToggle(True)
merge = Merge(Data1=pln_3, Data2=pln_4)  # -> flatten(Result)
merge_2 = Merge(Data1=move.Geometry, Data2=pl, Data3=move.Geometry)  # -> flatten(Result)
merge_3 = Merge(Data1=move.Geometry, Data2=pln_3)  # -> flatten(Result)
trajectory = RobotTrajectoryObject(TargetRobot=data_2, IsCartesian=toggle, TCPFrames=merge, TrajectoryWidth=0.01)  # -> Output, TrajectoryObject, TrajectoryMesh
trajectory_2 = RobotTrajectoryObject(TargetRobot=data_2, IsCartesian=toggle, TCPFrames=merge_3, TrajectoryWidth=0.01)  # -> Output, TrajectoryObject, TrajectoryMesh
trajectory_3 = RobotTrajectoryObject(TargetRobot=data_2, IsCartesian=toggle, TCPFrames=merge_2, TrajectoryWidth=0.01)  # -> Output, TrajectoryObject, TrajectoryMesh
merge_4 = Merge(Data1=trajectory.TrajectoryObject, Data2=trajectory_3.TrajectoryObject, Data3=trajectory_2.TrajectoryObject)
R = ClusterOutput(merge_4)
