# Grasshopper definition surface_agent_2.gh (Grasshopper 1.0.8)
# plug-ins: GH_MCP

# ---- group: geometry_agent
component_1 = Python3Script()  # -> out, a
# ---------- component_1: Python ----------
#! python 3

import Rhino.Geometry as rg
import math

# Parameters
rows = 10
cols = 10
width = 10.0
depth = 10.0
height = 2.5

points = []
for i in range(cols):
    for j in range(rows):
        # Map i and j to u and v coordinates from -0.5 to 0.5
        u = i / (cols - 1.0) - 0.5
        v = j / (rows - 1.0) - 0.5

        # Calculate x, y, z coordinates
        x = u * width
        y = v * depth
        
        # A simple sine-based bulge for the z coordinate
        z = height * math.cos(u * math.pi) * math.cos(v * math.pi)
        
        points.append(rg.Point3d(x, y, z))

# Create a new surface from the points
# The degree of the surface is typically 3 for a smooth surface
u_degree = 3
v_degree = 3
surface = rg.NurbsSurface.CreateFromPoints(points, cols, rows, u_degree, v_degree)

a = surface
# ---------- end component_1 ----------

# ----
mcp = GrasshopperMCP(Enabled=Toggle(True), Port=8081, Address="0.0.0.0")  # -> Status, LastCommand
panel = Panel(component_1.a)
